# Grasshopper definition 3. Roughing.gh (Grasshopper 1.0.4)

panel = Panel("Roughing Pass 2")
docstr = CSharpScript(Key="PassingHeight")  # -> out, A; inputs Key: String
# ---------- docstr: C# ----------
    doc = Rhino.RhinoDoc.ActiveDoc;
    for (int i = 0; i < doc.Strings.Count; i++)
    {
      if (String.Equals(doc.Strings.GetKey(i), Key as string, StringComparison.OrdinalIgnoreCase))
        A = doc.Strings.GetValue(i);
    }
# ---------- end docstr ----------
docstr_2 = CSharpScript(Key="Bit Diameter")  # -> out, A; inputs Key: String; same code as docstr
pipeline = GeometryPipeline(
    GroupByLayer=False,
    GroupByType=False,
    IncludeHidden=True,
    IncludeLocked=True,
    LayerFilter="Mold::Roughing Surfaces",
    NameFilter="*",
    SublayerFiltering=True,
    TypeFilter=1073741848)
panel_2 = Panel(docstr.A)
panel_3 = Panel(docstr_2.A)
division = Division(A=panel_3, B=2)
brep = Brep(graft(pipeline))
xz = XZPlane(Origin=Point(0, 0, 0))
Y = UnitY(Factor=1)
contour = Contour(Shape=brep, Point=xz, Direction=Y, Distance=division)
simplify = SimplifyTree(Tree=contour, Front=False)
trim = TrimTree(Tree=simplify, Depth=2)
path_mapper = PathMapper(trim, source="{A}", target="{A;0}")
panel_4 = Panel(path_mapper)
c_script = CSharpScript(BakeNow=Button(), Geometry=path_mapper, Layer="Roughing::Pass 2", CacheName="Roughing 2")  # -> out, A; inputs BakeNow: Boolean, Geometry: tree, Layer: String, CacheName: String
# ---------- c_script: C# ----------
    if (!BakeNow)
      return;

    var doc = Rhino.RhinoDoc.ActiveDoc;
    var result = new System.Text.StringBuilder();
    int layerIndex = 0;
    if (Layer == null)
      layerIndex = doc.Layers.CurrentLayerIndex;
    else
      layerIndex = doc.Layers.FindByFullPath(Layer, 0);
    var key = string.Format("Cache({0})", CacheName);

    // Delete existing cache data
    var existing = doc.Objects.FindByUserString(key, "*", false);
    foreach(RhinoObject obj in existing)
    {
      if (obj.Attributes.LayerIndex == layerIndex)
      {
        doc.Objects.Delete(obj, true);
      }
    }



    // Save geometry to model
    for (int i = 0; i < Geometry.Branches.Count; i++)
    {
      var path = Geometry.Paths[i];
      for (int g = 0; g < Geometry.Branches[i].Count; g++)
      {
        var geo = Geometry.Branches[i][g];
        var attr = new Rhino.DocObjects.ObjectAttributes();
        var cacheValue = string.Format("{0}({1})", path, g);
        attr.SetUserString(key, cacheValue);
        attr.LayerIndex = layerIndex;
        result.Append(cacheValue).Append("\r\n");
        result.Append(geo.GetType()).Append("\r\n");
        if (geo is Rhino.Geometry.Line)
          doc.Objects.AddLine((Rhino.Geometry.Line) geo, attr);
        else
          doc.Objects.Add((Rhino.Geometry.GeometryBase) geo, attr);
      }
    }
    A = result;
# ---------- end c_script ----------
